# Grasshopper definition IK.gh (Grasshopper 1.0.7)

segment_length = Slider(70.4, range=0..100)
segment_count = Slider(8, range=0..10)
target_point = Point(Point(592.7332945, 216.5799959, 0))
c_script = CSharpScript(SegmentLength=segment_length, SegmentCount=segment_count, TargetPoint=target_point, Reset=Button())  # -> out, LinesOut; inputs SegmentLength: Double, SegmentCount: Int32, TargetPoint: Point3d, Reset: Boolean
# ---------- c_script: C# ----------
    if (initialized && (!Reset))
    {
      // Do nothing
    }
    else
    {
      rArm = new RobotArm(SegmentCount, SegmentLength, TargetPoint);
      initialized = true;
    }
    rArm.TargetPoint = TargetPoint;
    rArm.Update();
    LinesOut = rArm.Show();
# ---------- c_script: C# additional code ----------
  public bool initialized = false;
  public RobotArm rArm;

  public class RobotArm
  {
    // Properties
    public List<Segment> Segments {get; set;}
    public Point3d TargetPoint {get; set;}

    // Constructor
    public RobotArm(int numSeg, double segLen, Point3d targetPt)
    {
      this.Segments = new List<Segment>();
      // for (variables; condition; change;)
      for (var x = 0; x < numSeg; x++)
      {
        // Add a segment
        Segment seg = new Segment(segLen, x);
        this.Segments.Add(seg);
        // Check whether the segment is the first segment
        if (x == 0)
        {
          // Do nothing
        }
        else
        {
          // If not, assign a parent segment to follow
          seg.ParentSegment = this.Segments[(x - 1)];
        }

      }
      this.TargetPoint = targetPt;
    }

    // Functions
    public void Update()
    {
      // For each Segment, call Segment.Update();
      for (var i = 0; i < this.Segments.Count; i++)
      {
        if (i == 0)
        {
          this.Segments[i].B = (this.TargetPoint - Point3d.Origin);
        }
        else
        {
          this.Segments[i].Update();
        }
      }
    }

    public List<Line> Show()
    {
      List<Line> lOut = new List<Line>();
      // For each Segment, call Segment.Show();
      for (var i = 0; i < this.Segments.Count; i++)
      {
        lOut.Add(this.Segments[i].Show());
      }
      return lOut;
    }

  }

  public class Segment
  {
    // Properties
    public Vector3d A {get; set;}
    public Vector3d B {get; set;}
    public double Length {get; set;}
    public int Index {get; set;}
    public Segment ParentSegment {get; set;}

    // Constructor
    public Segment(double len, int ind)
    {
      this.Length = len;
      this.Index = ind;
      this.ParentSegment = null;
    }

    // Functions
    public void Update()
    {
      Vector3d bTarget = this.ParentSegment.B;
      // bTarget - this.A
      Vector3d direction = Vector3d.Subtract(bTarget, this.A);
      double x = direction.X;
      double y = direction.Y;
      direction.Unitize();
      direction = Vector3d.Multiply(direction, (this.Length * (-1)));
      this.A = Vector3d.Add(bTarget, direction);
      this.B = this.A + direction;
    }

    public void FollowParent()
    {

    }

    public Line Show()
    {
      return new Line((Point3d.Origin + this.A), (Point3d.Origin + this.B));
    }

  }
# ---------- end c_script ----------
panel = Panel(c_script.LinesOut)
